# Grasshopper definition 3d.gh (Grasshopper 1.0.8)
# plug-ins: RhinoCodePluginGH, ComfyGH Info

panel = Panel("A four-legged chair in the shape of a seashell, Gaudi, white background")
comfy = Comfy(Run=Button(), UpdateParams=Button(), GH_LoadText_86=panel)  # -> Output, OUTPUT_IMAGE, OUTPUT_OBJ
ci = ComfyImage(comfy.OUTPUT_IMAGE)
panel_2 = Panel(comfy.OUTPUT_OBJ)
import = ImportContent(FilePath=comfy.OUTPUT_OBJ, Import=Toggle(True))
mesh = Mesh(import)
pt = Point(Point(1.467440932, 1.204627039, 0))
S = Script(x=mesh, y=pt)  # -> out, a; inputs x: Mesh, y: Point3d
# ---------- S: C# ----------
// Grasshopper Script Instance
using System;
using System.Collections;
using System.Collections.Generic;
using System.Drawing;

using Rhino;
using Rhino.Geometry;

using Grasshopper;
using Grasshopper.Kernel;
using Grasshopper.Kernel.Data;
using Grasshopper.Kernel.Types;

public class Script_Instance : GH_ScriptInstance
{
  /* 
    Members:
      RhinoDoc RhinoDocument
      GH_Document GrasshopperDocument
      IGH_Component Component
      int Iteration

    Methods (Virtual & overridable):
      Print(string text)
      Print(string format, params object[] args)
      Reflect(object obj)
      Reflect(object obj, string method_name)
  */
  
  private void RunScript(Mesh x, Point3d y, ref object a)
  {
    // Write your logic here
    BoundingBox bbox = x.GetBoundingBox(true);
    Point3d min = bbox.Min;
    Point3d max = bbox.Max;
    Point3d bottomCenter = new Point3d((min.X + max.X)/2, (min.Y + max.Y)/2, min.Z);
    Vector3d vec = y - bottomCenter;
    x.Translate(vec);
    a = x;
  }
}
# ---------- end S ----------
cache = ContentCache(Content=S.a)
